# Grasshopper definition packageDemonstrator.gh (Grasshopper 1.0.8)
# plug-ins: GHGlobalVars Info

# ---- group: Set Global Values
construct_point = ConstructPoint(XCoordinate=0, YCoordinate=0, ZCoordinate=0)
construct_mesh = ConstructMesh(Vertices=[Point(0, 0, 0), Point(10, 0, 0), Point(10, 10, 0), Point(0, 10, 0)], Faces={A=0, B=1, C=2, D=3})
input_keys = Panel("""A
B
C
D""")
ghglobalvarssetter = GHGlobalVarsSetter(Keys=input_keys, Values=[Slider(84, range=0..100), "a string!", construct_point, construct_mesh])  # -> GlobalVars, GlobalVarTypes
global_variables = Panel(ghglobalvarssetter.GlobalVars)
global_variable_types = Panel(ghglobalvarssetter.GlobalVarTypes)

# ---- group: Get Global Values
query_keys = Panel("""A
B
C
D""")
ghglobalvarsgetter = GHGlobalVarsGetter(Key=query_keys)  # -> Value, ValueType
output_values = Panel(ghglobalvarsgetter.Value)
output_value_types = Panel(ghglobalvarsgetter.ValueType)
data = Data(ghglobalvarsgetter.Value)
